# Grasshopper definition 1.miura ori tessellation.gh (Grasshopper 1.0.7)
# plug-ins: Weaverbird, Kangaroo2 Components, Pufferfish

planesrf = PlaneSurface(Plane=PlaneXY(0, 0, 0), XSize=Domain(-10, 10), YSize=Domain(-10, 10))
reset = GetBoolean(Toggle(False), AtLeast=1, AtMost=1, FalseValue="False", TrueValue="True")
folding_angle = GetInteger(Slider(102, range=0..180), AtLeast=1, AtMost=1, Maximum=2147483647, Minimum=-2147483648)
get_integer = GetInteger(Slider(100, range=0..100), AtLeast=1, AtMost=1, Maximum=2147483647, Minimum=-2147483648)
surface = GetGeometry(planesrf, AtLeast=1, AtMost=1, DeleteInput=False, Filter=1074004029)
u_param = GetNumber(Slider(20, range=0..100), AtLeast=1, AtMost=1, Maximum=1.797693135e+308, Minimum=-1.797693135e+308, Prompt="U param")
v_param = GetNumber(Slider(20, range=0..100), AtLeast=1, AtMost=1, Maximum=1.797693135e+308, Minimum=-1.797693135e+308)

range = Range(Domain=Domain(0, 1), Steps=u_param)
range_2 = Range(Domain=Domain(0, 1), Steps=v_param)
paramptdivsrf = ParameterPointDivideSurface(Surface=surface, ParametersU=range, ParametersV=range_2)  # -> simplify(Points), Normals

panel = Panel("""0
1""")
dispatch = Dispatch(List=paramptdivsrf.Points, DispatchPattern=panel)  # -> ListA, ListB
data = Data(dispatch.ListB)
data_2 = Data(dispatch.ListA)
X = UnitX(Factor=Slider(1, range=0..10))
cull_i = CullIndex(List=data, Indices=0, Wrap=True)
move = Move(Geometry=data_2, Motion=X)  # -> Geometry, Transform
flip = FlipMatrix(Data=move.Geometry)
flip_2 = FlipMatrix(Data=data)
pline = PolyLine(Vertices=flip_2, Closed=False)
pline_2 = PolyLine(Vertices=flip, Closed=False)
ln = Line(StartPoint=move.Geometry, EndPoint=data)
ln_2 = Line(StartPoint=move.Geometry, EndPoint=cull_i)  # -> simplify(Line)
explode = Explode(Curve=pline_2, Recursive=True)  # -> Segments, Vertices
explode_2 = Explode(Curve=pline, Recursive=True)  # -> Segments, Vertices
flip_3 = FlipMatrix(Data=ln)
flip_4 = FlipMatrix(Data=ln_2)
dispatch_2 = Dispatch(List=simplify(flip_3), DispatchPattern=[True, False])  # -> ListA, ListB
dispatch_3 = Dispatch(List=flip_4, DispatchPattern=[True, False])  # -> ListA, ListB
dispatch_4 = Dispatch(List=explode.Segments, DispatchPattern=[True, False])  # -> ListA, ListB
dispatch_5 = Dispatch(List=explode_2.Segments, DispatchPattern=[False, True])  # -> ListA, ListB
crv = Curve(simplify([dispatch_2.ListB, dispatch_3.ListB]))
crv_2 = Curve([dispatch_3.ListA, dispatch_2.ListA])
line = Line([dispatch_4.ListB, dispatch_5.ListB])
line_2 = Line([dispatch_4.ListA, dispatch_5.ListA])
merge = Merge(Data1=line_2, Data2=line, Data3=crv_2, Data4=crv)

swatch = ColourSwatch(SwatchColor=RGB(0, 0, 255))  # disabled
swatch_2 = ColourSwatch(SwatchColor=RGB(255, 0, 0))  # disabled

# ---- group: valley-mountain curves
valley = Curve(flatten([crv_2, line_2]))
valley_2 = Curve(flatten([line, crv]))

# ----
preview = CustomPreview(Geometry=valley, Material=swatch_2)  # disabled
preview_2 = CustomPreview(Geometry=valley_2, Material=swatch)  # disabled
solver = Solver(Reset=False, Threshold=1e-15, Tolerance=0.0001, On=True)  # -> I, V, O

wbweave = WeaverbirdsMeshFromLinesWeaveBack(Lines=flatten([valley, valley_2]), MaximumValence=4)

wbjoin = WeaverbirdsJoinMeshesAndWeld(Mesh=wbweave, Weld=False)

wbfacepolys = WeaverbirdsFacePolylines(Mesh=wbjoin)
disc = Discontinuity(Curve=wbfacepolys, Level=1)  # -> simplify(Points), Parameters
item = ListItem(List=disc.Points, Index=0, Wrap=True)  # -> Item, Item1, Item2, Item3
ln_3 = Line(StartPoint=item.Item, EndPoint=item.Item2)
ln_4 = Line(StartPoint=item.Item1, EndPoint=item.Item3)
merge_2 = Merge(Data1=ln_3, Data2=ln_4)

neg = Negative(Value=folding_angle)
rad = Radians(Degrees=folding_angle)
hingepoints = HingePoints(Mesh=wbjoin)  # -> _1, _2, _3, _4
rad_2 = Radians(Degrees=neg)
hingepoints_2 = HingePoints(Mesh=wbjoin)  # -> _1, _2, _3, _4
ln_5 = Line(StartPoint=hingepoints._1, EndPoint=hingepoints._2)
hinge = Hinge(FoldStart=hingepoints._1, FoldEnd=hingepoints._2, Tip1=hingepoints._3, Tip2=hingepoints._4, RestAngle=rad, Strength=1)
hinge_2 = Hinge(
    FoldStart=hingepoints_2._1,
    FoldEnd=hingepoints_2._2,
    Tip1=hingepoints_2._3,
    Tip2=hingepoints_2._4,
    RestAngle=rad_2,
    Strength=1)
ln_6 = Line(StartPoint=hingepoints_2._1, EndPoint=hingepoints_2._2)
curvepoint = PointOnCurve(ln_5, parameter=0.5)
curvepoint_2 = PointOnCurve(valley, parameter=0.5)
curvepoint_3 = PointOnCurve(ln_6, parameter=0.5)
curvepoint_4 = PointOnCurve(valley_2, parameter=0.5)
edgelengths = EdgeLengths(Mesh=wbjoin, LengthFactor=1, Strength=Slider(100, range=0..100))
nofoldthrough = NoFoldThrough(FoldStart=hingepoints._1, FoldEnd=hingepoints._2, Tip1=hingepoints._3, Tip2=hingepoints._4, Strength=1)
length_line = LengthLine(Line=merge_2, Strength=Slider(100, range=0..100))
show = Show(G=wbjoin)
pull = PullPoint(Point=curvepoint, Geometry=curvepoint_2, ClosestOnly=True)  # -> ClosestPoint, Distance
pull_2 = PullPoint(Point=curvepoint_3, Geometry=curvepoint_4, ClosestOnly=True)  # -> ClosestPoint, Distance
smaller = SmallerThan(FirstNumber=pull.Distance, SecondNumber=Slider(0.01, range=0..0.01))  # -> SmallerThan, OrEqualTo
smaller_2 = SmallerThan(FirstNumber=pull_2.Distance, SecondNumber=Slider(0.01, range=0..0.01))  # -> SmallerThan, OrEqualTo
cull = CullPattern(List=hinge, CullPattern=smaller.SmallerThan)
cull_2 = CullPattern(List=hinge_2, CullPattern=smaller_2.SmallerThan)

entwine = Entwine(Branch00=show, Branch01=[edgelengths, cull, cull_2, length_line, nofoldthrough], FlattenInputs=True)
bouncysolver = BouncySolver(
    GoalObjects=entwine,
    Reset=reset,
    Threshold=1e-15,
    Tolerance=0.0001,
    Damping=0.99,
    Iterations=get_integer,
    On=Toggle(True))  # -> I, V, O
item_2 = ListItem(List=bouncysolver.O, Index=0, Wrap=True)
rh_out_mesh = Mesh(item_2)
context_bake = ContextBake(Geometry=rh_out_mesh)
