# Grasshopper definition 2.folding paper from crease pattern.gh (Grasshopper 1.0.7)
# plug-ins: Weaverbird, Kangaroo2 Components, karambaGH

pipeline = GeometryPipeline(
    GroupByLayer=False,
    GroupByType=False,
    IncludeHidden=True,
    IncludeLocked=True,
    LayerFilter="mountains",
    NameFilter="*",
    SublayerFiltering=True,
    TypeFilter=4)
pipeline_2 = GeometryPipeline(
    GroupByLayer=False,
    GroupByType=False,
    IncludeHidden=True,
    IncludeLocked=True,
    LayerFilter="valleys",
    NameFilter="*",
    SublayerFiltering=True,
    TypeFilter=4)

# ---- group: valley-mountain curves
valley = Curve(flatten(pipeline_2))
valley_2 = Curve(flatten(pipeline))

# ----
valleys = GetLine(valley, AtLeast=1, AtMost=1000, Realtime=True)
mountains = GetLine(valley_2, AtLeast=1, AtMost=1000, Realtime=True)
reset = GetBoolean(Toggle(False), AtLeast=1, AtMost=1, FalseValue="False", TrueValue="True")
folding_angle = GetInteger(Slider(101, range=0..180), AtLeast=1, AtMost=1, Maximum=2147483647, Minimum=-2147483648)
iterations = GetInteger(Slider(100, range=0..100), AtLeast=1, AtMost=1, Maximum=2147483647, Minimum=-2147483648)

crv = Curve([valleys, mountains])
swatch = ColourSwatch(SwatchColor=RGB(0, 0, 255))  # disabled
swatch_2 = ColourSwatch(SwatchColor=RGB(255, 0, 0))  # disabled
preview = CustomPreview(Geometry=valleys, Material=swatch_2)  # disabled
preview_2 = CustomPreview(Geometry=mountains, Material=swatch)  # disabled
llinter = LineLineIntersectionKaramba3D(Line=crv, LimitDistance_m=0.005)  # -> IntersectionPoints, flatten(LineSubSegements)
solver = Solver(Reset=False, Threshold=1e-15, Tolerance=0.0001, On=True)  # -> I, V, O

wbweave = WeaverbirdsMeshFromLinesWeaveBack(Lines=flatten(llinter.LineSubSegements), MaximumValence=4)

wbjoin = WeaverbirdsJoinMeshesAndWeld(Mesh=wbweave, Weld=False)

wbfacepolys = WeaverbirdsFacePolylines(Mesh=wbjoin)
disc = Discontinuity(Curve=wbfacepolys, Level=1)  # -> simplify(Points), Parameters
item = ListItem(List=disc.Points, Index=0, Wrap=True)  # -> Item, Item1, Item2, Item3
ln = Line(StartPoint=item.Item, EndPoint=item.Item2)
ln_2 = Line(StartPoint=item.Item1, EndPoint=item.Item3)
merge = Merge(Data1=ln, Data2=ln_2)

neg = Negative(Value=folding_angle)
rad = Radians(Degrees=folding_angle)
hingepoints = HingePoints(Mesh=wbjoin)  # -> _1, _2, _3, _4
rad_2 = Radians(Degrees=neg)
hingepoints_2 = HingePoints(Mesh=wbjoin)  # -> _1, _2, _3, _4
ln_3 = Line(StartPoint=hingepoints._1, EndPoint=hingepoints._2)
hinge = Hinge(FoldStart=hingepoints._1, FoldEnd=hingepoints._2, Tip1=hingepoints._3, Tip2=hingepoints._4, RestAngle=rad, Strength=1)
hinge_2 = Hinge(
    FoldStart=hingepoints_2._1,
    FoldEnd=hingepoints_2._2,
    Tip1=hingepoints_2._3,
    Tip2=hingepoints_2._4,
    RestAngle=rad_2,
    Strength=1)
ln_4 = Line(StartPoint=hingepoints_2._1, EndPoint=hingepoints_2._2)
curvepoint = PointOnCurve(ln_3, parameter=0.5)
curvepoint_2 = PointOnCurve(valleys, parameter=0.5)
curvepoint_3 = PointOnCurve(ln_4, parameter=0.5)
curvepoint_4 = PointOnCurve(mountains, parameter=0.5)
edgelengths = EdgeLengths(Mesh=wbjoin, LengthFactor=1, Strength=Slider(100, range=0..100))
nofoldthrough = NoFoldThrough(FoldStart=hingepoints._1, FoldEnd=hingepoints._2, Tip1=hingepoints._3, Tip2=hingepoints._4, Strength=1)
length_line = LengthLine(Line=merge, Strength=Slider(100, range=0..100))
show = Show(G=wbjoin)
pull = PullPoint(Point=curvepoint, Geometry=curvepoint_2, ClosestOnly=True)  # -> ClosestPoint, Distance
pull_2 = PullPoint(Point=curvepoint_3, Geometry=curvepoint_4, ClosestOnly=True)  # -> ClosestPoint, Distance
smaller = SmallerThan(FirstNumber=pull.Distance, SecondNumber=Slider(0.01, range=0..0.01))  # -> SmallerThan, OrEqualTo
smaller_2 = SmallerThan(FirstNumber=pull_2.Distance, SecondNumber=Slider(0.01, range=0..0.01))  # -> SmallerThan, OrEqualTo
cull = CullPattern(List=hinge, CullPattern=smaller.SmallerThan)
cull_2 = CullPattern(List=hinge_2, CullPattern=smaller_2.SmallerThan)

entwine = Entwine(Branch00=show, Branch01=[edgelengths, cull, cull_2, length_line, nofoldthrough], FlattenInputs=True)
bouncysolver = BouncySolver(
    GoalObjects=entwine,
    Reset=reset,
    Threshold=1e-15,
    Tolerance=0.0001,
    Damping=0.99,
    Iterations=iterations,
    On=Toggle(True))  # -> I, V, O
item_2 = ListItem(List=bouncysolver.O, Index=0, Wrap=True)
rh_out_mesh = Mesh(item_2)
context_bake = ContextBake(Geometry=rh_out_mesh)
