# Grasshopper definition Origami folding for hops.gh (Grasshopper 1.0.7)
# plug-ins: Weaverbird, Kangaroo2 Components, Human

grab = Grab(On=Toggle(True), Strength=Slider(30, range=0..30), Range=3)

tolerance = GetNumber(
    Slider(0.01, range=0..0.01),
    {"0.01"}, selected=[],
    AtLeast=1,
    AtMost=1,
    Maximum=1.797693135e+308,
    Minimum=-1.797693135e+308,
    Prompt="number of iterations to simulate")
momentum = GetBoolean(Toggle(True), AtLeast=1, AtMost=1, FalseValue="False", Prompt="press true to fold with momentum", TrueValue="True")
iteration = GetNumber(Slider(507, range=0..3400), {"507"}, selected=[], AtLeast=1, AtMost=1, Maximum=5000, Minimum=-1.797693135e+308)
run = GetBoolean(Toggle(True), AtLeast=1, AtMost=1, FalseValue="False", Prompt="press true to fold", TrueValue="True")

# ----
# Rectangular Grid Origami
number_slider = Slider(10, range=0..10)
xy_plane = XYPlane(Origin=Point(0, 0, 0))
number_slider_2 = Slider(100, range=0..100)
panel = Panel("""0.9
0.8""")
negative = Negative(Value=Slider(0.19, range=0..1))

cell_size = GetNumber(
    number_slider,
    {"10"}, selected=[],
    AtLeast=1,
    AtMost=2147483647,
    Maximum=1.797693135e+308,
    Minimum=1,
    Prompt="unit cell size")
x_dir = GetNumber(
    Slider(10, range=0..15),
    {"10"}, selected=[],
    AtLeast=1,
    AtMost=2147483647,
    Maximum=1.797693135e+308,
    Minimum=-1.797693135e+308,
    Prompt="number of cells in X-direction")
y_dir = GetNumber(
    Slider(12, range=0..15),
    {"12"}, selected=[],
    AtLeast=1,
    AtMost=2147483647,
    Maximum=1.797693135e+308,
    Minimum=-1.797693135e+308,
    Prompt="number of cells in Y-direction")
damping = GetNumber(
    Slider(0.98, range=0..1),
    {"0.96"}, selected=[],
    AtLeast=1,
    AtMost=1,
    Maximum=1,
    Minimum=0,
    Prompt="use it when momentum is on value between 0 and 1")

rectangular = Rectangular(Plane=xy_plane, SizeX=cell_size, SizeY=cell_size, ExtentX=x_dir, ExtentY=y_dir)  # -> Cells, Points
mesh_brep = MeshBrep(
    Brep=flatten(rectangular.Cells),
    Settings={GridMaxCount=0, GridMinCount=16, JaggedSeams=False, MaxEdgeLength=0, MinEdgeLength=0.0001, MinTolerance=0, Refine=True, RefineAngle=0, RelativeTolerance=0.65, SimplePlanes=True, Tolerance=0})
weaverbird_s_join_meshes_and_weld = WeaverbirdsJoinMeshesAndWeld(Mesh=mesh_brep, Weld=True)
warpweft = WarpWeft(Mesh=weaverbird_s_join_meshes_and_weld)  # -> Warp, Weft, NakedA, NakedB
join_curves = JoinCurves(Curves=warpweft.Weft, Preserve=False)
curve = Curve(join_curves)
dispatch = Dispatch(List=curve, DispatchPattern=[True, False])  # -> ListA, ListB
edgelengths = EdgeLengths(Mesh=weaverbird_s_join_meshes_and_weld, LengthFactor=1, Strength=1)
show = Show(G=weaverbird_s_join_meshes_and_weld)

weaverbird_s_face_polylines = WeaverbirdsFacePolylines(Mesh=weaverbird_s_join_meshes_and_weld)
discontinuity = Discontinuity(Curve=weaverbird_s_face_polylines, Level=1)  # -> Points, Parameters
list_item = ListItem(List=discontinuity.Points, Index=0, Wrap=True)  # -> Item, Item1, Item2, Item3
line = Line(StartPoint=list_item.Item, EndPoint=list_item.Item2)
line_2 = Line(StartPoint=list_item.Item1, EndPoint=list_item.Item3)
merge = Merge(Data1=line, Data2=line_2)  # -> flatten(Result)
length_line = LengthLine(Line=merge, Strength=10)

planarize = Planarize(M=weaverbird_s_join_meshes_and_weld, Strength=Slider(3, range=0..10))

fold_angle = GetNumber(
    Slider(123, range=0..175),
    {"120"}, selected=[],
    AtLeast=1,
    AtMost=2147483647,
    Maximum=180,
    Minimum=1,
    Prompt="specify rest angle in degrees")

radians = Radians(Degrees=fold_angle)

mountain_curve = Curve(dispatch.ListA)
explode = Explode(Curve=mountain_curve, Recursive=True)  # -> flatten(Segments), Vertices
hingepoints = HingePoints(Mesh=weaverbird_s_join_meshes_and_weld)  # -> _1, _2, _3, _4
line_3 = Line(StartPoint=hingepoints._1, EndPoint=hingepoints._2)
hinge = Hinge(
    FoldStart=hingepoints._1,
    FoldEnd=hingepoints._2,
    Tip1=hingepoints._3,
    Tip2=hingepoints._4,
    RestAngle=radians,
    Strength=1)
evaluate_length = EvaluateLength(Curve=line_3, Length="0.5", Normalized=True)  # -> Point, Tangent, Parameter
evaluate_length_2 = EvaluateLength(Curve=explode.Segments, Length="0.5", Normalized=True)  # -> Point, Tangent, Parameter
pull_point = PullPoint(Point=evaluate_length.Point, Geometry=evaluate_length_2.Point, ClosestOnly=True)  # -> ClosestPoint, Distance
smaller_than = SmallerThan(FirstNumber=pull_point.Distance, SecondNumber="0.01")  # -> SmallerThan, OrEqualTo
cull_pattern = CullPattern(List=hinge, CullPattern=smaller_than.SmallerThan)

valley_curve = Curve(dispatch.ListB)
explode_2 = Explode(Curve=valley_curve, Recursive=True)  # -> flatten(Segments), Vertices
hingepoints_2 = HingePoints(Mesh=weaverbird_s_join_meshes_and_weld)  # -> _1, _2, _3, _4
line_4 = Line(StartPoint=hingepoints_2._1, EndPoint=hingepoints_2._2)
negative_2 = Negative(Value=radians)
hinge_2 = Hinge(
    FoldStart=hingepoints_2._1,
    FoldEnd=hingepoints_2._2,
    Tip1=hingepoints_2._3,
    Tip2=hingepoints_2._4,
    RestAngle=negative_2,
    Strength=1)
evaluate_length_3 = EvaluateLength(Curve=line_4, Length="0.5", Normalized=True)  # -> Point, Tangent, Parameter
evaluate_length_4 = EvaluateLength(Curve=explode_2.Segments, Length="0.5", Normalized=True)  # -> Point, Tangent, Parameter
pull_point_2 = PullPoint(Point=evaluate_length_3.Point, Geometry=evaluate_length_4.Point, ClosestOnly=True)  # -> ClosestPoint, Distance
smaller_than_2 = SmallerThan(FirstNumber=pull_point_2.Distance, SecondNumber="0.01")  # -> SmallerThan, OrEqualTo
cull_pattern_2 = CullPattern(List=hinge_2, CullPattern=smaller_than_2.SmallerThan)

merge_2 = Merge(Data1=show, Data2=grab, Data3=planarize, Data4=length_line, Data5=edgelengths, Data6=cull_pattern_2, Data7=cull_pattern)  # -> flatten(Result)

stepsolver = StepSolver(GoalObjects=merge_2, Tolerance=tolerance, Momentum=momentum, Damping=damping, SubIterations=iteration, Animate=run)  # -> I, V, O

sort_objects_by_type = SortObjectsByType(RhinoObjects=stepsolver.O)  # -> Points, Curves, Surfaces, Breps, Meshes, TextObjects, HatchObjects, LightObjects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
mesh = Mesh(sort_objects_by_type.Meshes)
face_boundaries = FaceBoundaries(Mesh=mesh)
dash_pattern = DashPattern(Curve=face_boundaries, Pattern=panel)  # -> Dashes, Gaps
custom_preview_lineweights = CustomPreviewLineweights(
    Geometry=dash_pattern.Dashes,
    Shader=ColourSwatch(SwatchColor=RGB(0, 0, 0)),
    Thickness=Slider(6, range=0..10),
    Absolute=False)
offset_curve_loose = OffsetCurveLoose(Curve=face_boundaries, Distance=negative)
boundary_surfaces = BoundarySurfaces(Edges=offset_curve_loose)
custom_preview = CustomPreview(Geometry=boundary_surfaces, Material=ColourSwatch(SwatchColor=RGB(235, 207, 0)))

boundary_surfaces_2 = BoundarySurfaces(Edges=face_boundaries)
context_bake = ContextBake(PlanarSrf=boundary_surfaces_2)

warpweft_2 = WarpWeft(Mesh=mesh)  # -> Warp, Weft, NakedA, NakedB
curve_2 = Curve(warpweft_2.Weft)
curve_3 = Curve(warpweft_2.Warp)
custom_preview_lineweights_2 = CustomPreviewLineweights(Geometry=curve_2, Shader=ColourSwatch(SwatchColor=RGB(217, 11, 11)), Thickness=Slider(6, range=0..10), Absolute=False)
custom_preview_lineweights_3 = CustomPreviewLineweights(Geometry=curve_3, Shader=ColourSwatch(SwatchColor=RGB(221, 0, 255)), Thickness=Slider(6, range=0..10), Absolute=False)

context_bake_2 = ContextBake(XCurves=curve_2)
context_bake_3 = ContextBake(YCurves=curve_3)
